# Grasshopper definition gHowl_UDP_send+receive.ghx (Grasshopper 0.9.75)
# plug-ins: gHowl

port = Panel("7001")
udp_owl = UDPReceiver(Port=port, Pattern=0)  # -> Info, Data
# try either domain box or center box!
panel = Panel(udp_owl.Data)
split = StringSplit(String=udp_owl.Data, Separators=";")
partition = PartitionList(List=split, Size=4)
panel_2 = Panel(partition)
bang = ExplodeTree(Data=panel_2)  # -> Branch0, Branch1
split_2 = SplitList(List=bang.Branch0, Index=2)  # -> ListA, ListB
split_3 = SplitList(List=split_2.ListA, Index=1)  # -> ListA, ListB
split_1 = SplitList(List=split_2.ListB, Index=1)  # -> ListA, ListB
split_2_2 = SplitList(List=bang.Branch1, Index=2)  # -> ListA, ListB
pt = ConstructPoint(XCoordinate=split_3.ListA, YCoordinate=split_3.ListB, ZCoordinate=0)
split_4 = SplitList(List=split_2_2.ListA, Index=1)  # -> ListA, ListB
split_1_2 = SplitList(List=split_2_2.ListB, Index=1)  # -> ListA, ListB
panel_3 = Panel(bang.Branch0)
panel_4 = Panel(bang.Branch1)
pt_2 = ConstructPoint(XCoordinate=split_4.ListA, YCoordinate=split_4.ListB, ZCoordinate=0)
box = DomainBox(Base=pt, X=split_1.ListA, Y=split_1.ListB, Z=Domain(0, 2))
panel_5 = Panel(box)
box_2 = DomainBox(Base=pt_2, X=split_1_2.ListA, Y=split_1_2.ListB, Z=Domain(0, 2))
panel_6 = Panel(box_2)
